# Grasshopper definition 3dcp_Base_GH_Template.gh (Grasshopper 1.0.7)
# plug-ins: KUKA|prc - parametric robot control, DendroGH

# ---- group: 原始的
plane_a = Plane(Plane(origin=(-487, 831, -435), x=(0.9997123019, -0.02392473885, -0.001708909918), y=(0.02390597081, 0.999661481, -0.01026781271)))
plane = Plane(Plane(origin=(107, 819, -453), x=(0.999936913, -0.01083675472, 0.00295547856), y=(0.01083708922, 0.9999412723, -9.718915386e-05)))
plane_b = Plane(Plane(origin=(739, 802, -435), x=(0.999928172, -0.01198544042, 0), y=(0.01198501305, 0.9998925174, -0.008444712633)))
# 1. SETUP
panel = Panel([plane, plane_a, plane_b])

# ----
# Robot Workspace
selected_plane = ValueList({"PlaneO": 0, "PlaneA": 1, "PlaneB": 2}, selected="PlaneA")
correction = Slider(10, range=0..50)

# ----
# Concrete Printing
# Environment
world_collision = Mesh(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)
# 工作區域
shelf_collision = Mesh(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)
mjoin = MeshJoin(Meshes=[world_collision, shelf_collision])
world_visual = Mesh([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])
collision = Mesh(mjoin)

# ----
# Tool
探針 = Slider(40, range=0..100)
addition = Addition(A=探針, B="-730.795")
frame = FrameKUKAPrc(FrameNumber=0, XValue=addition, YValue="-3.746", ZValue="163.803", AValue="0", BValue="180", CValue="90", toolaxis="X")  # -> KUKAPrcFrame, XYZABCAsPlane
mesh = Mesh(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)
custom_tool_pln = CustomToolPlaneKUKAPrc(ToolGeometry=mesh, ToolNumber="9", ToolPlane=frame.XYZABCAsPlane, frameinput=False)

# ----
# Safe Working Area
panel_2 = Panel("-1100")
frame_2 = FrameKUKAPrc(FrameNumber=0, XValue=panel_2, YValue="140", ZValue="-480", AValue=0, BValue=0, CValue=0, toolaxis="Z")  # -> KUKAPrcFrame, XYZABCAsPlane
box = DomainBox(Base=frame_2.XYZABCAsPlane, X="3000", Y="2000", Z="6000")

python = GhPythonScript()  # -> planeO, planeA, planeB
# ---------- python: Python ----------
import rhinoscriptsyntax as rs

# planeO,planeA,planeB
planeO = rs.PlaneFromPoints([107, 819, -453], [1122, 808, -450], [129, 1322, -453])
planeA = rs.PlaneFromPoints([-487, 831, -435], [98, 817, -436], [-467, 1414, -441])
planeB = rs.PlaneFromPoints([739, 802, -453], [1323, 795, -435], [748, 1394, -440])
# ---------- end python ----------
plane_b_2 = Plane(Plane(origin=(739, 802, -435), x=(0.999928172, -0.01198544042, 0), y=(0.01198501305, 0.9998925174, -0.008444712633)))
# SETUP
io = IO()  # -> _0, _1, _2, _3

# ----
# Raccoon KUKA Robot Cell Template
# Robot
cluster = Cluster()  # -> robot, robot_2

cluster_2 = Cluster_2(data=selected_plane, _0=python.planeO, _1=python.planeA, _2=python.planeB, O=correction, X=Slider(0, range=-300..300))  # -> G, srf_2, C
digout03_on = Data(io._3)
digout02_on = Data(io._2)
python_2 = GhPythonScript(plane=selected_plane, correction=correction)  # -> plane, vector; inputs plane: Int32
# ---------- python_2: Python ----------
import Rhino.Geometry as rg
import rhinoscriptsyntax as rs
import compas.geometry as cg

planeO = cg.Plane.from_three_points([107, 819, -453], [1122, 808, -450], [129, 1322, -453])
planeA = cg.Plane.from_three_points([-487, 831, -435], [98, 817, -436], [-467, 1414, -441])
planeB = cg.Plane.from_three_points([739, 802, -453], [1323, 795, -435], [748, 1394, -440])

planeList = [planeO, planeA, planeB]
plane = planeList[plane]

correction_vec = cg.Vector(0, 0, correction) #z = correction
plane.point += correction_vec

# Function to convert COMPAS plane to Rhino.Geometry plane
def compas_to_rhino_plane(compas_plane):
    origin = rg.Point3d(compas_plane.point.x, compas_plane.point.y, compas_plane.point.z)
    normal = rg.Vector3d(compas_plane.normal.x, compas_plane.normal.y, compas_plane.normal.z)
    return rg.Plane(origin, normal)



# Convert COMPAS planes to Grasshopper-compatible planes
plane = compas_to_rhino_plane(plane)
vector = plane.ZAxis
# ---------- end python_2 ----------
deplane = DeconstructPlane(Plane=cluster_2.G)  # -> Origin, XAxis, YAxis, ZAxis
plane_2 = Plane(cluster_2.G)
panel_3 = Panel([python_2.plane, python_2.vector])
group = Group()
bbox = BoundingBox(Content=flatten(group), Plane=PlaneXY(0, 0, 0), UnionBox=True)  # -> Box, Box_2

# ----
# 列印速度
列印速度_m_sec = Slider(0.15, range=0..1)

box_2 = EvaluateBox(Box=bbox.Box, UParameter="0.5", VParameter="0.5", WParameter="0")  # -> Plane, Point, Include
orient = Orient(Geometry=group, Source=box_2.Plane, Target=plane_2)  # -> Geometry, Transform
ungroup = Ungroup(Group=orient.Geometry)
xy = XYPlane(Origin=ungroup)
tstat = TreeStatistics(Tree=xy)  # -> Paths, Length, Count
item = ListItem(List=tstat.Paths, Index=0, Wrap=True)  # -> Item1, Item
branch = TreeBranch(Tree=xy, Path=item.Item, MaintainPaths=True)
panel_4 = Panel(branch)
branch_2 = TreeBranch(Tree=xy, Path=item.Item1, MaintainPaths=True)
flatten = FlattenTree(Tree=xy, Path="{0}")
python_3 = GhPythonScript(plane=flatten)  # -> plane, startPt, endPt; inputs plane: list of Plane
# ---------- python_3: Python ----------
import rhinoscriptsyntax as rs

plane = plane
a = len(plane) - 1

startPt = plane[0]
endPt = plane[a]
# ---------- end python_3 ----------
# 2. OPERATIONS
panel_5 = Panel("-200")
X = UnitX(Factor=panel_5)
number_slider = Slider(900, range=0..10000)
Z = UnitZ(Factor="100")
預設填料點 = Plane(Plane(origin=(-837.4158325, 606.9471436, -70.23432159), x=(0.7511875281, -0.6597975782, -0.01960748343), y=(0.6597758639, 0.7495853845, 0.05308069962)))
move = Move(Geometry=python_3.endPt, Motion=X)  # -> Geometry, Transform
move_2 = Move(Geometry=python_3.startPt, Motion=Z)  # -> Geometry, Transform
merge = Merge(Data1=move.Geometry, Data2=預設填料點)
lin_move = LINearMovementKUKAPrc(TargetAsPlane=branch, Speed=列印速度_m_sec, ExternalAxis1=number_slider, extaxenabled=True, interpolation="C_VEL")
lin_move_2 = LINearMovementKUKAPrc(TargetAsPlane=branch_2, ExternalAxis1=number_slider, extaxenabled=True, interpolation="C_VEL")
lin_move_3 = LINearMovementKUKAPrc(
    TargetAsPlane=move_2.Geometry,
    Speed=Slider(0.05, range=0..0.1),
    ExternalAxis1=number_slider,
    extaxenabled=True,
    interpolation="C_VEL")
lin_move_4 = LINearMovementKUKAPrc(TargetAsPlane=python_3.startPt, Speed=列印速度_m_sec, ExternalAxis1=number_slider, extaxenabled=True, interpolation="C_VEL")
lin_move_5 = LINearMovementKUKAPrc(TargetAsPlane=python_3.plane, Speed=列印速度_m_sec, ExternalAxis1=number_slider, extaxenabled=True, interpolation="C_VEL")
lin_move_6 = LINearMovementKUKAPrc(TargetAsPlane=merge, Speed=列印速度_m_sec, ExternalAxis1=number_slider, extaxenabled=True, interpolation="C_VEL")
開始出料 = Data(io._1)
停止出料 = Data(io._0)
entwine = Entwine(
    Branch00=lin_move_3,
    Branch01=lin_move_4,
    Branch02=lin_move,
    Branch03=開始出料,
    Branch04=lin_move_5,
    Branch05=停止出料,
    Branch06=lin_move_2,
    Branch07=lin_move_6,
    FlattenInputs=True)
data = Data(flatten(entwine))
dam = DataDam(DataA=data, BufferDelay=10000000, BufferMode=0)

# ----
# 3. Simulation, Analysis, Post-Processing
# West Robot
number_slider_2 = Slider(0, range=0..1)
save_krl_file = Button()
python_4 = GhPythonScript(plane=selected_plane, speed=列印速度_m_sec, save=save_krl_file)  # -> save, name; inputs plane: Int32, height: Int32, layers: Int32, save: Boolean
# ---------- python_4: Python ----------
import rhinoscriptsyntax as rs

SelectedPlane = ['planeO', 'planeA', 'planeB']

SelectedPlane = SelectedPlane[plane]

height = str(height)
layers = str(layers)
speed = str(speed)

n = "W_CP_"+ height+ '_'+ layers+ '_'+ speed+ '_'+ SelectedPlane
n = n.replace('.', 'd')

name = str(n)
# ---------- end python_4 ----------
panel_6 = Panel(python_4.name)
kuka_prc = KUKAPrcCORE(
    SimulationSlider=number_slider_2,
    KUKAPrcCommands=dam,
    Tool=custom_tool_pln,
    Robot=cluster.robot_2,
    CollisionGeometry=collision,
    SaveToggle=python_4.save,
    Filename="test01_2",
    PRC_BaseExpose=False,
    PRC_SaveNameExpose=True,
    PRCsettings="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")  # -> RobotGeometry, AnalysisOutput; disabled

# ----
# 3. Simulation, Analysis, Post-Processing
analysis = AnalysisKUKAPrc(KUKAPrcAnalysisData=kuka_prc.AnalysisOutput)  # -> RobotAxisValues, RobotCollisionCheck, RobotReachabilityCheck, CommandID, TimeValue, flatten(Planes), CommandTags, IOState, Index, KRL

模擬 = ValueList({"開": 0, "關": 1}, selected="關")
rec = DataRecorder(DataLimit=-10, RecordData=True)

pln = Plane(flatten(rec))
vsettings = CreateSettings(VoxelSize=Slider(8, range=0..100), Bandwidth=1, Isovalue=0, Adaptivity=0.1)
nurbs = NurbsCurve(Vertices=pln, Degree=3, Periodic=False)  # -> Curve, Length, Domain
# 4. Visualization
data_2 = Data(world_visual)
data_3 = Data([cluster_2.C, box])
# OPERATIONS
swatch = ColourSwatch(SwatchColor=RGB(255, 255, 255))
# Robot Workspace
swatch_2 = ColourSwatch(SwatchColor=RGBA(230, 170, 87, 212))
wires = BrepWireframe(Brep=data_2, Density=-1)
data_4 = Data(cluster_2.srf_2)
data_5 = Data(cluster_2.C)
wires_2 = BrepWireframe(Brep=data_3, Density=-1)
vcurve = CurveToVolume(Curves=nurbs.Curve, CurveRadius=Slider(20, range=0..100), Settings=vsettings)
preview = CustomPreview(Geometry=data_4, Material=swatch_2)
preview_2 = CustomPreview(Geometry=data_5, Material=ColourSwatch(SwatchColor=RGB(255, 0, 0)))
preview_3 = CustomPreview(Geometry=wires, Material=ColourSwatch(SwatchColor=RGB(0, 0, 0)))
preview_4 = CustomPreview(Geometry=data_2, Material=ColourSwatch(SwatchColor=RGBA(255, 255, 255, 16)))
preview_5 = CustomPreview(Geometry=vcurve, Material=ColourSwatch(SwatchColor=RGB(153, 153, 153)))
preview_6 = CustomPreview(Geometry=wires_2, Material=swatch)

# ==== cluster Cluster
geo = Geometry(flatten([<brep referenced from the Rhino model> x622]))
smooth = SettingsQuality()
holder = Mesh([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])
join = BrepJoin(Breps=holder)  # -> Breps, Closed
mesh = MeshBrep(
    Brep=holder,
    Settings={GridMaxCount=0, GridMinCount=16, JaggedSeams=False, MaxEdgeLength=0, MinEdgeLength=0.0001, MinTolerance=0, Refine=True, RefineAngle=0, RelativeTolerance=0.65, SimplePlanes=True, Tolerance=0})
mjoin = MeshJoin(Meshes=holder)
panel = Panel(mjoin)
kr90_kr270_r2500 = QuantecKR90KR270R2500Robot(infiniterot=False)
panel_2 = Panel("""37.5
2403.3
-2.0
0.0
90.0
-0.1812""")
panel_3 = Panel("""37.0714
2402.8586
-2.0
0.2993
0.0052
0.0001""")
panel_4 = Panel("""0.0
-2400.0
0.0
0.0
90.0
0.0""")
panel_5 = Panel("""-2.06
-2400.320
0
0.01421
-0.0074
0.00""")
west_platform = Mesh(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)
east_platform = Mesh(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)
panel_6 = Panel("""675.0
350.0
1150.0
1000.0
-41.0
240.0""")
rail = Mesh(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)
e1_min = Panel("0")
e1_max = Panel("4270")
item = ListItem(List=panel_4, Index=0, Wrap=True)  # -> Item, Item1, Item2, Item3, Item4, Item5
item_2 = ListItem(List=panel_5, Index=0, Wrap=True)  # -> Item, Item1, Item2, Item3, Item4, Item5
item_3 = ListItem(List=panel_2, Index=0, Wrap=True)  # -> Item, Item1, Item2, Item3, Item4, Item5
item_4 = ListItem(List=panel_3, Index=0, Wrap=True)  # -> Item, Item1, Item2, Item3, Item4, Item5
custom_robot = CustomRobot(ReferenceRobot=kr90_kr270_r2500, RobotName="KR300-R2500", Layout=panel_6)
frame = FrameKUKAPrc(
    FrameNumber=0,
    XValue=item.Item,
    YValue=item.Item1,
    ZValue=item.Item2,
    AValue=item.Item3,
    BValue=item.Item4,
    CValue=item.Item5,
    toolaxis="X")  # -> KUKAPrcFrame, XYZABCAsPlane
frame_2 = FrameKUKAPrc(
    FrameNumber=0,
    XValue=item_2.Item,
    YValue=item_2.Item1,
    ZValue=item_2.Item2,
    AValue=item_2.Item3,
    BValue=item_2.Item4,
    CValue=item_2.Item5,
    toolaxis="Z")  # -> KUKAPrcFrame, XYZABCAsPlane
frame_3 = FrameKUKAPrc(
    FrameNumber=0,
    XValue=item_3.Item,
    YValue=item_3.Item1,
    ZValue=item_3.Item2,
    AValue=item_3.Item3,
    BValue=item_3.Item4,
    CValue=item_3.Item5,
    toolaxis="X")  # -> KUKAPrcFrame, XYZABCAsPlane
frame_4 = FrameKUKAPrc(
    FrameNumber=0,
    XValue=item_4.Item,
    YValue=item_4.Item1,
    ZValue=item_4.Item2,
    AValue=item_4.Item3,
    BValue=item_4.Item4,
    CValue=item_4.Item5,
    toolaxis="Z")  # -> KUKAPrcFrame, XYZABCAsPlane
deplane = DeconstructPlane(Plane=frame.XYZABCAsPlane)  # -> Origin, XAxis, YAxis, ZAxis
deplane_2 = DeconstructPlane(Plane=frame_3.XYZABCAsPlane)  # -> Origin, XAxis, YAxis, ZAxis
move = Move(Motion=Vector(0, 0, 10))  # -> Geometry, Transform
orient = Orient(Geometry=west_platform, Source=PlaneXY(0, 0, 0), Target=frame_2.XYZABCAsPlane)  # -> Geometry, Transform
orient_2 = Orient(Geometry=rail, Source=PlaneXY(0, 0, 0), Target=frame_2.XYZABCAsPlane)  # -> Geometry, Transform
orient_3 = Orient(Geometry=rail, Source=PlaneXY(0, 0, 0), Target=frame_4.XYZABCAsPlane)  # -> Geometry, Transform
orient_4 = Orient(Geometry=east_platform, Source=PlaneXY(0, 0, 0), Target=frame_4.XYZABCAsPlane)  # -> Geometry, Transform
orient_5 = Orient(Geometry=holder, Source=PlaneXY(0, 0, 0), Target=frame_4.XYZABCAsPlane)  # -> Geometry, Transform
panel_7 = Panel(orient_4.Geometry)
custom_rail = CustomLinearAxisKUKAPrc(
    KUKAPrcRobotInput=custom_robot,
    RobotRail=orient_3.Geometry,
    RobotPlatform=orient_4.Geometry,
    PositiveLength=e1_max,
    NegativeLength=e1_min,
    PositiveDirection=deplane_2.XAxis,
    RobotBase=frame_4.XYZABCAsPlane)
custom_rail_2 = CustomLinearAxisKUKAPrc(
    KUKAPrcRobotInput=custom_robot,
    RobotRail=orient_2.Geometry,
    RobotPlatform=orient.Geometry,
    PositiveLength=e1_max,
    NegativeLength=e1_min,
    PositiveDirection=deplane.XAxis,
    RobotBase=frame_2.XYZABCAsPlane)
robot = ClusterOutput(custom_rail_2)
robot_2 = ClusterOutput(custom_rail)

# ==== cluster IO
toggle = BooleanToggle(False)
toggle_2 = BooleanToggle(True)
digital_out = DigitalOutputKUKAPrc(DigitalOutputNumber="1", OutputState=toggle_2, ContinuousMovement=toggle_2, ToolState=-1)
digital_out_2 = DigitalOutputKUKAPrc(DigitalOutputNumber="1", OutputState=toggle, ContinuousMovement=toggle_2, ToolState=-1)
digital_out_3 = DigitalOutputKUKAPrc(DigitalOutputNumber="2", OutputState=toggle_2, ContinuousMovement=toggle_2, ToolState=-1)
digital_out_4 = DigitalOutputKUKAPrc(DigitalOutputNumber="3", OutputState=toggle_2, ContinuousMovement=toggle_2, ToolState=-1)
digital_out_5 = DigitalOutputKUKAPrc(DigitalOutputNumber="2", OutputState=toggle, ContinuousMovement=toggle_2, ToolState=-1)
digital_out_6 = DigitalOutputKUKAPrc(DigitalOutputNumber="3", OutputState=toggle, ContinuousMovement=toggle_2, ToolState=-1)
merge = Merge(Data1=digital_out_2, Data2=digital_out_5, Data3=digital_out_6)
merge_2 = Merge(Data1=digital_out, Data2=digital_out_5, Data3=digital_out_6)
merge_3 = Merge(Data1=digital_out_2, Data2=digital_out_3, Data3=digital_out_6)
merge_4 = Merge(Data1=digital_out_2, Data2=digital_out_5, Data3=digital_out_4)
entwine = Entwine(Branch0X=merge, Branch1X=merge_2, Branch2X=merge_3, Branch3X=merge_4, FlattenInputs=False)  # -> simplify(Result)
bang = ExplodeTree(Data=entwine)  # -> flatten(Branch0), flatten(Branch1), flatten(Branch2), flatten(Branch3)
_0 = ClusterOutput(bang.Branch0)
_1 = ClusterOutput(bang.Branch1)
_2 = ClusterOutput(bang.Branch2)
_3 = ClusterOutput(bang.Branch3)

# ==== cluster Cluster_2
data = ClusterInput()
_0 = ClusterInput()
_1 = ClusterInput()
_2 = ClusterInput()
O = ClusterInput()
X = ClusterInput()
data_2 = Data(data)
panel = Panel("""2400
1200""")
panel_2 = Panel("""1200
1200""")
filter = StreamFilter(Gate=data_2, Stream0=_0, Stream1=_1, Stream2=_2)
filter_2 = StreamFilter(Gate=data_2, Stream0=panel, Stream1=panel_2, Stream2=panel_2)
item = ListItem(List=filter_2, Index=0, Wrap=True)  # -> Item, Item1
pl_offset = PlaneOffset(BasePlane=filter, Offset=O)
planesrf = PlaneSurface(Plane=pl_offset, XSize=item.Item, YSize=item.Item1)
area = Area(Geometry=planesrf)  # -> Area, Centroid
neg = Negative(Value=Slider(100, range=0..100))
orient = Orient(Geometry=planesrf, Source=area.Centroid, Target=pl_offset)  # -> Geometry, Transform
vec = VectorXYZ(XComponent=X, YComponent=X, ZComponent=0)  # -> Vector, Length
move = Move(Geometry=pl_offset, Motion=vec.Vector)  # -> Geometry, Transform
offset_l = OffsetCurveLoose(Curve=orient.Geometry, Distance=neg)
srf = Surface(orient.Geometry)
panel_3 = Panel(move.Geometry)
G = ClusterOutput(move.Geometry)
srf_2 = ClusterOutput(srf)
C = ClusterOutput(offset_l)
